# Grasshopper definition 04_Timber aggregation v2.gh (Grasshopper 1.0.8)
# plug-ins: Pufferfish

crv = Curve(<curve referenced from the Rhino model>)
mesh = Mesh(<mesh referenced from the Rhino model>)

# ----
# Timber Dimension
number_slider = Slider(19, range=0..100)
number_slider_2 = Slider(100, range=0..100)

# ----
# Overlapping Distance
# Number of layers
number_slider_3 = Slider(40, range=0..100)
# X Axis Gap
number_slider_4 = Slider(3, range=0..10)
# Gap to Concrete
number_slider_5 = Slider(20, range=0..100)
Z = UnitZ(Factor=Slider(0, range=0..1000))
addition = Addition(A=number_slider, B=Slider(2, range=0..10))
move = Move(Geometry=crv, Motion=Z)  # -> Geometry, Transform
multiplication = Multiplication(A=addition, B="2")
pframe = PerpFrame(Curve=reparameterize(move.Geometry), Parameter="0")
series = Series(Start=0, Step=multiplication, Count=10)
deplane = DeconstructPlane(Plane=pframe)  # -> Origin, XAxis, YAxis, ZAxis
multiplication_2 = Multiplication(A=deplane.XAxis, B=series)
subtraction = Subtraction(A=number_slider_2, B=number_slider_3)
pframe_2 = PerpFrame(Curve=reparameterize(move.Geometry), Parameter="0")
neg = Negative(Value=multiplication_2)
series_2 = Series(Start=0, Step=subtraction, Count=number_slider_4)
deplane_2 = DeconstructPlane(Plane=pframe_2)  # -> Origin, XAxis, YAxis, ZAxis
move_2 = Move(Geometry=move.Geometry, Motion=neg)  # -> Geometry, Transform
multiplication_3 = Multiplication(A=deplane_2.YAxis, B=series_2)
neg_2 = Negative(Value=multiplication_3)
move_3 = Move(Geometry=move_2.Geometry, Motion=graft(neg_2))  # -> Geometry, Transform
pframe_3 = PerpFrame(Curve=reparameterize(move.Geometry), Parameter="0")
deplane_3 = DeconstructPlane(Plane=pframe_3)  # -> Origin, XAxis, YAxis, ZAxis
multiplication_4 = Multiplication(A=deplane_3.XAxis, B=Slider(0, range=0..1000))
multiplication_5 = Multiplication(A=deplane_3.XAxis, B=addition)
neg_3 = Negative(Value=multiplication_4)
neg_4 = Negative(Value=multiplication_5)
dup = DuplicateData(Data=neg_4, Number=number_slider_4, Order=True)
dup_2 = DuplicateData(Data=neg_3, Number=number_slider_4, Order=True)
tstat = TreeStatistics(Tree=move_3.Geometry)  # -> Paths, Length, Count
weave = Weave(Pattern=[0, 1, 0, 1], Stream0=dup_2, Stream1=dup, NullGaps=False)
short = ShortestList(ListA=tstat.Length, ListB=weave, TrimMode=2)  # -> ListA, ListB
move_4 = Move(Geometry=move_3.Geometry, Motion=graft(short.ListB))  # -> Geometry, Transform
ext = ExtendCurve(Curve=move_4.Geometry, Type=0, Start=Slider(459, range=0..500), End=Slider(0, range=0..100))
end = EndPoints(Curve=move_4.Geometry)  # -> flatten(Start), flatten(End)
mcx = MeshCurve(Mesh=mesh, Curve=flatten(ext))  # -> Points, Faces
pt = Point(end.End)
item = ListItem(List=mcx.Points, Index=0, Wrap=True)  # -> Item1, Item
dom = ConstructDomain(DomainStart=0, DomainEnd=number_slider)
dom_2 = ConstructDomain(DomainStart=0, DomainEnd=number_slider_2)
ln = Line(StartPoint=item.Item1, EndPoint=graft(pt))
pframe_4 = PerpFrame(Curve=reparameterize(ln), Parameter="0")
deplane_4 = DeconstructPlane(Plane=pframe_4)  # -> Origin, XAxis, YAxis, ZAxis
pl = ConstructPlane(Origin=deplane_4.Origin, XAxis=deplane_4.YAxis, YAxis=deplane_4.ZAxis)
len = Length(Curve=ln)
rectangle = Rectangle(Plane=pl, XSize=dom_2, YSize=len, Radius=0)  # -> Rectangle, Length
disc = Discontinuity(Curve=rectangle.Rectangle, Level=1)  # -> Points, Parameters
boundary = BoundarySurfaces(Edges=rectangle.Rectangle)
shatter = Shatter(Curve=rectangle.Rectangle, Parameters=disc.Parameters)
item_2 = ListItem(List=shatter, Index=0, Wrap=True)  # -> Item, Item1, Item2, Item3
offmsh = OffsetMesh(Mesh=mesh, Distance=number_slider_5, BothSides=0, CreateSolid=False)
crv_2 = Curve(item_2.Item2)
mmx = MeshMesh(MeshA=boundary, MeshB=offmsh)
flip = FlipCurve(Curve=mmx, Guide=crv_2)  # -> Curve, Flag
loft = Loft(
    Curves=[crv_2, flip.Curve],
    Options={Adjust=False, Closed=False, LoftEnds=0, LoftSimp=0, LoftType=0, Rebuild=10, Refit=0.01})
multiplication_6 = Multiplication(A=deplane_4.XAxis, B=number_slider)
extr = Extrude(Base=loft, Direction=multiplication_6)
fit = FitCurve()  # -> flatten(Curve)
divide = DivideCurve(Curve=fit, Count=10, Kinks=False)  # -> Points, Tangents, Parameters
plfit = PlaneFit(Points=divide.Points)  # -> Plane, Deviation
item_3 = ListItem(List=fit, Index=0, Wrap=True)
number_slider_6 = Slider(20, range=0..100)
neg_5 = Negative(Value=number_slider_6)
flip_2 = FlipCurve(Curve=fit, Guide=item_3)  # -> Curve, Flag
offset = OffsetCurve(Curve=graft(flip_2.Curve), Distance=[neg_5, number_slider_6], Plane=plfit.Plane, Corners=1)
orient = Orient(Source=PlaneXY(0, 0, 0), Target=PlaneXY(0, 0, 0))  # -> Geometry, Transform
trim = TrimTree(Tree=offset, Depth=1)
end_2 = EndPoints(Curve=trim)  # -> Start, End
divide_2 = DivideCurve(Curve=trim, Count=10, Kinks=False)  # -> Points, Tangents, Parameters
pdecon = Deconstruct(Point=divide_2.Points)  # -> XComponent, YComponent, ZComponent
avr = Average(Input=pdecon.ZComponent)
trim_2 = TrimTree(Tree=avr, Depth=1)
sort = SortList(Keys=trim_2, ValuesA=trim)  # -> Keys, ValuesA
item_4 = ListItem(List=sort.ValuesA, Index=0, Wrap=True)  # -> Item1, Item
crv_3 = Curve(item_4.Item1)
ext_2 = ExtendCurve(Curve=crv_3, Type=0)
